# Dynamo graph RengaDyn_Sample_MigrateProperties_Export.dyn (Dynamo 2.12.1.8246)

# group: Получение идентификаторов всех свойств из Менеджера свойств проекта
application = DynRenga.DynDocument.Application.Application()
project = DynRenga.DynDocument.Project.Project.Project(renga_application=application)
propertyManager = DynRenga.DynProperties.Properties.PropertyManager.PropertyManager(renga_project=project)
getAllProperties = DynRenga.DynProperties.Properties.PropertyManager.GetAllProperties(propertyManager=propertyManager)

# group: Имя и Тип свойств
getPropertyType = DynRenga.DynProperties.Properties.PropertyManager.GetPropertyType(propertyManager=propertyManager, property_id=getAllProperties)
getTypeAsString = DynRenga.DynProperties.Properties.Property.GetTypeAsString(renga_property_type=getPropertyType)
code_block = CodeBlock { "PropertyType_"; ""; }
replace = String.Replace(string=getTypeAsString, searchFor=code_block.out0, replaceWith=code_block.out1)
getPropertyName = DynRenga.DynProperties.Properties.PropertyManager.GetPropertyName(propertyManager=propertyManager, property_id=getAllProperties)
add = Python(IN[0]=getPropertyName)  # CPython3
# ---------- add.python (5 lines) ----------
input_names = IN[0]
to_out = list()
for one_name in input_names:
	to_out.append('"' + one_name + '"')
OUT = to_out
# ----------------------------------------

stringByGuid = DynRenga.Other.RengaSimpleInterfaces.StringByGuid(guid=getAllProperties)

# group: Все типы объектов Renga
allObjectTypes = DynRenga.DynObjects.General.AllObjectTypes()
stringByGuid_2 = DynRenga.Other.RengaSimpleInterfaces.StringByGuid(guid=allObjectTypes)
list_create = List.Create(item0=stringByGuid_2)
count = List.Count(list=getAllProperties)
cycle = List.Cycle(list=list_create, amount=count)

# group: Определение, каким типам объектов назначено данное свойство
isPropertyAssignedToTypes = DynRenga.DynProperties.Properties.PropertyManager.IsPropertyAssignedToTypes(propertyManager=propertyManager, property_id=getAllProperties, object_types=allObjectTypes)
filterByBoolMask = List.FilterByBoolMask(list=cycle, mask=isPropertyAssignedToTypes)

# group: Объединение информации о свойстве в список и запись в файл CSV
directory_path = Directory("E:\Temp")
code_block_2 = CodeBlock(a=directory_path) { a; b =a + "\\props_out.csv"; }
python_script = Python(IN[0]=stringByGuid, IN[1]=add, IN[2]=getTypeAsString, IN[3]=filterByBoolMask.in)  # CPython3
# ---------- python_script.python (17 lines) ----------
#source data
prop_guids = IN[0]
prop_names = IN[1]
prop_types = IN[2]
prop_to_assigns = IN[3]

to_out = list()
for counter_prop in range(0,len(prop_guids),1):
	temp_list = list()
	temp_list.append(prop_guids[counter_prop])
	temp_list.append(prop_names[counter_prop])
	temp_list.append(prop_types[counter_prop])
	obj_types =';'.join(prop_to_assigns[counter_prop])
	temp_list.append(obj_types)
	if len(obj_types) != 0:
	   to_out.append(temp_list)
OUT = to_out
# ----------------------------------------
exportCSV = Data.ExportCSV(filePath=code_block_2.b, data=python_script)
