# Dynamo graph RengaDyn_Sample_MigrateProperties_Import.dyn (Dynamo 2.12.1.8246)

# group: Получение менеджера свойств
application = DynRenga.DynDocument.Application.Application()
project = DynRenga.DynDocument.Project.Project.Project(renga_application=application)
propertyManager = DynRenga.DynProperties.Properties.PropertyManager.PropertyManager(renga_project=project)

# group: Чтение файла свойств
file_path = Filename("E:\Temp\props_out.csv")
чтение_csv = Python(IN[0]=file_path)  # CPython3
# ---------- чтение_csv.python (24 lines) ----------
file_path = IN[0]
row_file = list()
with open(file_path, encoding="utf8") as file:
    for line in file:
        row_file.append(line)
    file.close()
ids = list()
names = list()
types = list()
to_assign = list()

for one_property in row_file:
    prop_list = one_property.split(',')
    ids.append(prop_list[0])
    #find name
    kav = '"'
    index_start = one_property.find(kav)
    index_end = one_property[index_start + 1:].find(kav)
    names.append(one_property[index_start + 1:index_end + index_start + 1])
    prop_list = one_property[index_end + index_start + 3:].split(',')
    #other
    types.append(prop_list[0])
    to_assign.append(prop_list[1].split(';'))
OUT = ids,names,types,to_assign
# ----------------------------------------
code_block = CodeBlock(a=чтение_csv) { a[0]; a[1]; a[2]; a[3]; }
guidByString = DynRenga.Other.RengaSimpleInterfaces.GuidByString(guid_str=code_block.out0)
getPropertyTypeByString = DynRenga.DynProperties.Properties.Property.GetPropertyTypeByString(prop_type=code_block.out2)
guidByString_2 = DynRenga.Other.RengaSimpleInterfaces.GuidByString(guid_str=code_block.out3)

# group: 1. Создание определения свойств
createPropertyDescription = DynRenga.DynProperties.Properties.PropertyManager.CreatePropertyDescription(propertyManager=propertyManager, name=code_block.out1, property_type=getPropertyTypeByString)
propertyDescription = DynRenga.DynProperties.Properties.PropertyDescription.PropertyDescription(PropertyDescription_obj=createPropertyDescription)

# group: 2. Регистрация свойств и назначение их категориям объектов Renga
registerProperty2 = DynRenga.DynProperties.Properties.PropertyManager.RegisterProperty2(propertyManager=propertyManager, property_id=guidByString, prop_description_existed=propertyDescription)
code_block_2 = CodeBlock(wait=registerProperty2, manager=propertyManager) { wait; manager; }
assignPropertyToTypes = DynRenga.DynProperties.Properties.PropertyManager.AssignPropertyToTypes(propertyManager=code_block_2.manager, property_id=guidByString, object_types=guidByString_2)
