# Dynamo graph RengaDyn_Sample_PropertyTrianglesCount_Getting.dyn (Dynamo 2.12.1.8246)

# group: Получение объектов модели
application = DynRenga.DynDocument.Application.Application()
project = DynRenga.DynDocument.Project.Project.Project(renga_application=application)
model = DynRenga.DynDocument.Model.Model(renga_project=project)
getModelObjects = DynRenga.DynObjects.Selection.GetModelObjects(renga_model=model)
id = DynRenga.DynObjects.ModelObject.Id(modelObject=getModelObjects)

# group: Уточнение выборки только для объектов, имеющих 3D представление
dataExporter = DynRenga.DynDocument.DataExporter.DataExporter(renga_project=project)
exportedObject3D = DynRenga.DynObjects.ExportedObject3D.ExportedObject3D(DataExporter=dataExporter, modelobject_id=id)
checkIsNotNull = DynRenga.Other.Technical.CheckIsNotNull(ClassForCheck=exportedObject3D)
filterByBoolMask = List.FilterByBoolMask(list=id, mask=checkIsNotNull)
getModelObjectById = DynRenga.DynObjects.Selection.GetModelObjectById(renga_model=model, model_object_id=filterByBoolMask.in)

id_2 = DynRenga.DynObjects.ModelObject.Id(modelObject=getModelObjectById)
getObjectsData = DynRenga.DynObjects.ModelObject.GetObjectsData(modelObject=getModelObjectById)

# group: Получение свойств с сортировкой их для нужного диапазона
code_block = CodeBlock { "f2c90cc5-bc21-41a4-acc3-ba8d07345a0e"; }
guidByString = DynRenga.Other.RengaSimpleInterfaces.GuidByString(guid_str=code_block)
get = DynRenga.DynProperties.Properties.PropertyContainer.Get(propertyContainer=getObjectsData.Properties_IPropertyContainer, prop_id=guidByString)
getIntegerValue = DynRenga.DynProperties.Properties.Property.GetIntegerValue(property=get)
number = DoubleInput(100)
python_script = Python(IN[0]=getIntegerValue, IN[1]=number)  # CPython3
# ---------- python_script.python (7 lines) ----------
to_out = []
for a in IN[0]:
	if a != None and a > 0 and a > IN[1]:
		to_out.append(True)
	else:
		to_out.append(False)
OUT = to_out
# ----------------------------------------

# group: Получение идентификаторов НУЖНЫХ объектов модели
filterByBoolMask_2 = List.FilterByBoolMask(list=id_2, mask=python_script)

# group: На выбор -- выделение объектов
selectObjectsInModelByIds = DynRenga.DynObjects.Selection.SelectObjectsInModelByIds(renga_application=application, model_objects_ids=filterByBoolMask_2.in)

# group: На выбор -- изоляция объектов
activeView = DynRenga.DynDocument.Application.ActiveView(application=application)  # frozen
modelView = DynRenga.DynDocument.Views.ModelView.ModelView(view_Model=activeView)
code_block_2 = CodeBlock { true; false; }
setObjectsVisibility = DynRenga.DynDocument.Views.ModelView.SetObjectsVisibility(modelView=modelView, object_ids=filterByBoolMask_2.in, visiable=code_block_2.out0)
