# Dynamo graph RengaDyn_Sample_PyIFC-reading_1.dyn (Dynamo 2.12.1.8246)

application = DynRenga.DynDocument.Application.Application()
project = DynRenga.DynDocument.Project.Project.Project(renga_application=application)

# group: Создание и регистрация нового объектного свойства для сохранения в IFC файле
propertyManager = DynRenga.DynProperties.Properties.PropertyManager.PropertyManager(renga_project=project)
code_block = CodeBlock { "Object_internal_id"; "15107363-32ac-45f3-9d88-54ae0f8fd0d6"; }
guidByString = DynRenga.Other.RengaSimpleInterfaces.GuidByString(guid_str=code_block.out1)
code_block_2 = CodeBlock(prop_id=guidByString) { wait_reg; prop_id; }  # unwired: wait_reg
allObjectTypes = DynRenga.DynObjects.General.AllObjectTypes()
propertyTypes = DynRenga.DynProperties.Properties.Property.PropertyTypes()

undefined = CodeBlock(a=allObjectTypes) { [a[38],a[4]]; }
python_script = Python(IN[0]=allObjectTypes, IN[1]=undefined)  # CPython3
# ---------- python_script.python (7 lines) ----------
ids = IN[0]
id_undefined = IN[1]
new_list = []
for id in ids:
	if id not in id_undefined:
		new_list.append(id)
OUT = new_list
# ----------------------------------------

# group (continued): Создание и регистрация нового объектного свойства для сохранения в IFC файле
assignPropertyToType = DynRenga.DynProperties.Properties.PropertyManager.AssignPropertyToType(propertyManager=propertyManager, property_id=code_block_2.prop_id, object_type=python_script)
code_block_3 = CodeBlock(wait_reg=assignPropertyToType, model=project) { wait_reg; model; }

# group: Выборка объектов модели
model = DynRenga.DynDocument.Model.Model(project=code_block_3.model)
getObjectsByType = DynRenga.DynObjects.Selection.GetObjectsByType(renga_model=model, object_type=python_script)
flatten = List.Flatten(list=getObjectsByType)
modelObject = DynRenga.DynObjects.ModelObject.ModelObject(model_object_com=flatten)

id = DynRenga.DynObjects.ModelObject.Id(modelObject=modelObject)
string_from_object = FromObject(object=id)

# group: Заполнение нового свойства объектным идентификатором
getObjectsData = DynRenga.DynObjects.ModelObject.GetObjectsData(modelObject=modelObject)
propertyContainer = DynRenga.DynProperties.Properties.PropertyContainer.PropertyContainer(PropertyContainer_obj=getObjectsData.Properties_IPropertyContainer)
get = DynRenga.DynProperties.Properties.PropertyContainer.Get(propertyContainer=propertyContainer, prop_id=guidByString)
property = DynRenga.DynProperties.Properties.Property.Property(Property_obj=get)
setStringValue = DynRenga.DynProperties.Properties.Property.SetStringValue(property=property, value_string=string_from_object)

# group: Преобразование объектного идентификатора в строку
uniqueId = DynRenga.DynObjects.ModelObject.UniqueId(modelObject=modelObject)
stringByGuid = DynRenga.Other.RengaSimpleInterfaces.StringByGuid(guid=uniqueId)

createPropertyDescription = DynRenga.DynProperties.Properties.PropertyManager.CreatePropertyDescription(propertyManager=propertyManager, name=code_block.out0, property_type=propertyTypes.PropertyType_String)
propertyDescription = DynRenga.DynProperties.Properties.PropertyDescription.PropertyDescription(PropertyDescription_obj=createPropertyDescription)
registerProperty2 = DynRenga.DynProperties.Properties.PropertyManager.RegisterProperty2(propertyManager=propertyManager, property_id=guidByString, prop_description_existed=propertyDescription)
name = DynRenga.DynObjects.ModelObject.Name(modelObject=modelObject)

# group: Для отладки
objectType = DynRenga.DynObjects.ModelObject.ObjectType(modelObject=modelObject)
getObjectIdAsString = DynRenga.DynObjects.General.GetObjectIdAsString(obj_type_guid=objectType)
