# Dynamo graph RengaDyn_Sample_PyIFC-reading_2.dyn (Dynamo 2.12.1.8246)

# group: Получение осей
application = DynRenga.DynDocument.Application.Application()
project = DynRenga.DynDocument.Project.Project.Project(renga_application=application)
model = DynRenga.DynDocument.Model.Model(project=project)
objectTypes = DynRenga.DynObjects.General.ObjectTypes()
getObjectsByType = DynRenga.DynObjects.Selection.GetObjectsByType(renga_model=model, object_type=objectTypes.Roof)
modelObject = DynRenga.DynObjects.ModelObject.ModelObject(model_object_com=getObjectsByType)
name = DynRenga.DynObjects.ModelObject.Name(modelObject=modelObject)
code_block = CodeBlock { "Ось - "; ""; }
replace = String.Replace(string=name, searchFor=code_block.out0, replaceWith=code_block.out1)

# group: Получение геометрии осей
file_path = Filename("E:\DataTest\Renga\House.ifc")
code_block_2 = CodeBlock { "IFCROOF"; }
get_axis = Python(IN[0]=file_path, IN[1]=code_block_2, IN[2]=replace)  # CPython3
# ---------- get_axis.python (29 lines) ----------
import sys
import os
import uuid
localapp = os.getenv(r'LOCALAPPDATA')
sys.path.append(os.path.join(localapp, r'python-3.8.3-embed-amd64\Lib\site-packages'))
import ifcopenshell
import clr
clr.AddReference('ProtoGeometry')
from Autodesk.DesignScript.Geometry import Point, Line




#input data
ifc_file_path = IN[0]
ifc_class = IN[1]
axis_names = IN[2]

#output data
info  = []
ifc_file = ifcopenshell.open(ifc_file_path)

objects = ifc_file.by_type(ifc_class)
for obj in objects:
    info_one = obj.GlobalId
    expanded = uuid.UUID(str(info_one))
    #guid_obj =  ifcopenshell.guid.compress(expanded.hex)
    info.append(info_one)
OUT = info
# ----------------------------------------

parameterType = DynRenga.DynProperties.Parameters.ParameterDefinition.ParameterType()  # unwired: parameterDefinition
id = DynRenga.DynObjects.ModelObject.Id(modelObject=modelObject)
uniqueId = DynRenga.DynObjects.ModelObject.UniqueId(modelObject=modelObject)
