# Dynamo graph demo_load_osm.dyn (Dynamo 2.12.1.8246)

# group: Получение группы свойств о Здании в свойствах проекта
application = DynRenga.DynDocument.Application.Application()
project = DynRenga.DynDocument.Project.Project.Project(renga_application=application)
IBuildingInfo = DynRenga.DynDocument.Project.Project.IBuildingInfo(project=project)
buildingInfo = DynRenga.DynDocument.Project.BuildingInfo.BuildingInfo(BuildingInfo_com=IBuildingInfo)

# group: Получаем набор связанных свойств
getProperties = DynRenga.DynDocument.Project.BuildingInfo.GetProperties(buildingInfo=buildingInfo)
propertyContainer = DynRenga.DynProperties.Properties.PropertyContainer.PropertyContainer(PropertyContainer_obj=getProperties)
getAllProperties = DynRenga.DynProperties.Properties.PropertyContainer.GetAllProperties(propertyContainer=propertyContainer)
property = DynRenga.DynProperties.Properties.Property.Property(Property_obj=getAllProperties)

# group: Получение базовой точки здания и создание вокруг него рамки с получением ограничивающих крайних точек
name = DynRenga.DynProperties.Properties.Property.Name(property=property)
getValue = DynRenga.DynProperties.Properties.Property.GetValue(property=property)
координаты_в_метрах = CodeBlock(a=getValue) { a[3]/1000.0; a[2]/1000.0; 0.0; a[5]*(-1); "Rissia-MSK52-Zona2"; }
byCoordinates = Point.ByCoordinates(x=координаты_в_метрах.out0, y=координаты_в_метрах.out1, z=координаты_в_метрах.out2)
code_block = CodeBlock { 200.0; }
byCenterPointRadius = Circle.ByCenterPointRadius(centerPoint=byCoordinates, radius=code_block)
byGeometry = BoundingBox.ByGeometry(geom=byCenterPointRadius)
minPoint = BoundingBox.MinPoint(boundingBox=byGeometry)
maxPoint = BoundingBox.MaxPoint(boundingBox=byGeometry)

code_block_2 = CodeBlock { true; "E:\\Temp"; "test1"; }
code_block_3 = CodeBlock { 1.0; }

# group: Getting EPSG code for cs using filter-criteria
projected_russian_crs_list = dyn_proj_library.ProjDB_resources.projected_russian_crs_list()
code_block_4 = CodeBlock { "MSK52"; }
contains = String.Contains(string=projected_russian_crs_list.CS_names, searchFor=code_block_4)
filterByBoolMask = List.FilterByBoolMask(list=projected_russian_crs_list.CS_names, mask=contains)
indexOf = List.IndexOf(list=projected_russian_crs_list.CS_names, element=filterByBoolMask.in)
getItemAtIndex = List.GetItemAtIndex(list=projected_russian_crs_list.EPSG_codes, index=indexOf)
code_block_5 = CodeBlock(a=getItemAtIndex) { a[1]; 4326; }

list_create = List.Create(item0=minPoint, item1=maxPoint)
reproject_dynamo_point = dyn_proj_library.Reprojecting.Reproject_dynamo_point(cs_source_code=code_block_5.out0, cs_target_code=code_block_5.out1, source_point=list_create)
code_block_6 = CodeBlock(a=reproject_dynamo_point) { a[0]; a[1]; }

# group: Min point
Y = Point.Y(point=code_block_6.out0)
X = Point.X(point=code_block_6.out0)

# group: Max point
Y_2 = Point.Y(point=code_block_6.out1)
X_2 = Point.X(point=code_block_6.out1)

# group: Create BoundingBox for load OSM data
OSM_data = osm2dyn.OSM_data.OSM_data(min_longitude=Y, min_latitude=X, max_longitude=Y_2, max_latitude=X_2)

# group: Getting polygons andreproject data from geographic coordinates and project to UTM84-31N
OSM_polygons = osm2dyn.OSM_data.OSM_polygons(oSM_data=OSM_data)
getGeometry = osm2dyn.OSM_object.GetGeometry(oSM_object=OSM_polygons)
reproject_point_as_double_array = dyn_proj_library.Reprojecting.Reproject_point_as_double_array(cs_source_code=code_block_5.out1, cs_target_code=code_block_5.out0, source_point=getGeometry)
getAttributes = osm2dyn.OSM_object.GetAttributes(oSM_object=OSM_polygons)

reprojecting = dyn_proj_library.Reprojecting.Reprojecting(dx=координаты_в_метрах.out0, dy=координаты_в_метрах.out1, dz=координаты_в_метрах.out2, angle_value=координаты_в_метрах.out3, scale=code_block_3, source_point=reproject_point_as_double_array)
dynamoPoint = dyn_proj_library.Reprojecting.DynamoPoint(reprojecting=reprojecting)

# group: Create Buildings from polygons
byPoints = Polygon.ByPoints(points=dynamoPoint)
heightOfStorey = DoubleInput(3)
getBuildingsPolygons = Python(IN[0]=byPoints, IN[1]=getAttributes, IN[2]=heightOfStorey)  # IronPython2
# ---------- getBuildingsPolygons.python (22 lines) ----------
#input_data
polygons = IN[0]
attributes = IN[1]
storey_height = float(IN[2])

import clr
clr.AddReference('ProtoGeometry')
from Autodesk.DesignScript.Geometry import Curve, Line, Point, Polygon

counter_1 = 0
osm_buildins = list()
osm_natural = list()
for one_dict in attributes:
	#check, is that plg is building
	plg_needing = polygons[counter_1]
	plg_center = plg_needing.Center()
	if one_dict.get("building") != None:
		level_value_temp = one_dict.get("levels",storey_height)
		level_value = float(level_value_temp)*3.0
		osm_buildins.append(Curve.SweepAsSolid(plg_needing,Line.ByStartPointEndPoint(plg_center, Point.ByCoordinates(plg_center.X,plg_center.Y,plg_center.Z + level_value))))
	counter_1+=1
OUT = osm_buildins
# ----------------------------------------

ifc_document_specs = dyn2ifc.IfcFile.IfcDoc.ifc_document_specs()
ifc_units = dyn2ifc.IfcFile.IfcDoc.ifc_units()
initIfcDatabase = dyn2ifc.IfcFile.IfcDoc.InitIfcDatabase(ifc_type=ifc_document_specs.Ifc4Reference, units=ifc_units.Metre)
code_block_7 = CodeBlock(data=getBuildingsPolygons, hhl=initIfcDatabase) { data; hhl; }
as_IfcShapeRepresentation = dyn2ifc.IfcGeometry.as_IfcShapeRepresentation.as_IfcShapeRepresentation(solid=code_block_7.data)
get_IfcFaceBasedSurfaceModel = dyn2ifc.IfcGeometry.as_IfcShapeRepresentation.Get_IfcFaceBasedSurfaceModel(as_IfcShapeRepresentation=as_IfcShapeRepresentation)
code_block_8 = CodeBlock(a=initIfcDatabase) { "osm_data"; a; }
ifcGrouping = dyn2ifc.IfcGrouping.IfcGrouping(name=code_block_8.out0)
group = dyn2ifc.IfcGrouping.group(ifcGrouping=ifcGrouping)
to_IfcBuildingElementProxy = dyn2ifc.IfcObject.to_IfcBuildingElementProxy(ifcShapeRepresentation=get_IfcFaceBasedSurfaceModel, group=group)
code_block_9 = CodeBlock { "building"; null; }
code_block_10 = CodeBlock { [0.0,0.0,0.0]; "black"; }
ifcMaterialSet = dyn2ifc.IfcMaterialSet.IfcMaterialSet(color_data=code_block_10.out0, material_name=code_block_10.out1)
material = dyn2ifc.IfcMaterialSet.material(ifcMaterialSet=ifcMaterialSet)
ifcObject = dyn2ifc.IfcObject.IfcObject(ifc_element=to_IfcBuildingElementProxy, GlobalId=code_block_9.out0, name=code_block_9.out0, material=material, description=code_block_9.out0, properties=code_block_9.out1)
code_block_11 = CodeBlock(d=ifcObject, c=code_block_8.a) { d; c; }
count = List.Count(list=code_block_11.d)
saveIfc = dyn2ifc.IfcFile.IfcDoc.SaveIfc(directory_path=code_block_2.out1, file_name=code_block_2.out2, Overwrite=code_block_2.out0, aux_order=count)
