# Dynamo graph test_add_prop.dyn (Dynamo 2.12.1.8246)

# group: Получение объекта модели
application = DynRenga.DynDocument.Application.Application()
project = DynRenga.DynDocument.Project.Project.Project(renga_application=application)
model = DynRenga.DynDocument.Model.Model(project=project)
getModelObjects = DynRenga.DynObjects.Selection.GetModelObjects(renga_model=model)
modelObject = DynRenga.DynObjects.ModelObject.ModelObject(model_object_com=getModelObjects)

# group: Создание и регистрация нового объектного свойства для сохранения в IFC файле
propertyManager = DynRenga.DynProperties.Properties.PropertyManager.PropertyManager(renga_project=project)
code_block = CodeBlock { "Object_internal_id"; "15107363-32ac-45f3-9d88-54ae0f8fd0d6"; }
guidByString = DynRenga.Other.RengaSimpleInterfaces.GuidByString(guid_str=code_block.out1)
propertyTypes = DynRenga.DynProperties.Properties.Property.PropertyTypes()
propertyDescription = DynRenga.DynProperties.Properties.PropertyDescription.PropertyDescription(name=code_block.out0, prop_type=propertyTypes.PropertyType_String)
registerProperty = DynRenga.DynProperties.Properties.PropertyManager.RegisterProperty(propertyManager=propertyManager, property_id=guidByString, prop_description_new=propertyDescription)  # frozen
allObjectTypes = DynRenga.DynObjects.General.AllObjectTypes()
assignPropertyToType = DynRenga.DynProperties.Properties.PropertyManager.AssignPropertyToType(propertyManager=propertyManager, property_id=guidByString, object_type=allObjectTypes)  # frozen

# group: Преобразование объектного идентификатора в строку
uniqueId = DynRenga.DynObjects.ModelObject.UniqueId(modelObject=modelObject)
stringByGuid = DynRenga.Other.RengaSimpleInterfaces.StringByGuid(guid=uniqueId)

# group: Заполнение нового свойства объектным идентификатором
getObjectsData = DynRenga.DynObjects.ModelObject.GetObjectsData(modelObject=modelObject)
propertyContainer = DynRenga.DynProperties.Properties.PropertyContainer.PropertyContainer(PropertyContainer_obj=getObjectsData.Properties_IPropertyContainer)
get = DynRenga.DynProperties.Properties.PropertyContainer.Get(propertyContainer=propertyContainer, prop_id=guidByString)
property = DynRenga.DynProperties.Properties.Property.Property(Property_obj=get)
setStringValue = DynRenga.DynProperties.Properties.Property.SetStringValue(property=property, value_string=stringByGuid)

file_path = Filename("G:\Soft\Renga\IFCMap\export_attr_qto_pset.json")
добавление_в_файл_export_attr = Python(IN[0]=file_path, IN[1]=code_block.out0, IN[2]=code_block.out1)  # "Добавление в файл export_attr_qto_pset.json информации о свойстве"; IronPython2
# ---------- добавление_в_файл_export_attr.python (5 lines) ----------
import json
from json import *
#source data
renga
OUT = 0
# ----------------------------------------
