# Dynamo graph test_assign_triangles_count.dyn (Dynamo 2.12.1.8246)

application = DynRenga.DynDocument.Application.Application()
project = DynRenga.DynDocument.Project.Project.Project(renga_application=application)
propertyManager = DynRenga.DynProperties.Properties.PropertyManager.PropertyManager(renga_project=project)

# group: Создание нового свойства и регистрация его в программе
code_block = CodeBlock { "f2c90cc5-bc21-41a4-acc3-ba8d07345a0e"; }
guidByString = DynRenga.Other.RengaSimpleInterfaces.GuidByString(guid_str=code_block)
code_block_2 = CodeBlock { "Количество_3d-граней"; }
propertyTypes = DynRenga.DynProperties.Properties.Property.PropertyTypes()
createPropertyDescription = DynRenga.DynProperties.Properties.PropertyManager.CreatePropertyDescription(propertyManager=propertyManager, name=code_block_2, property_type=propertyTypes.PropertyType_Integer)  # frozen
propertyDescription = DynRenga.DynProperties.Properties.PropertyDescription.PropertyDescription(PropertyDescription_obj=createPropertyDescription)
registerProperty2 = DynRenga.DynProperties.Properties.PropertyManager.RegisterProperty2(propertyManager=propertyManager, property_id=guidByString, prop_description_existed=propertyDescription)

# group: Назначение свойства всем категориям оьъектов Renga
allObjectTypes = DynRenga.DynObjects.General.AllObjectTypes()
code_block_3 = CodeBlock(a=registerProperty2, types=allObjectTypes) { a; types; }
assignPropertyToType = DynRenga.DynProperties.Properties.PropertyManager.AssignPropertyToType(propertyManager=propertyManager, property_id=guidByString, object_type=code_block_3.types)

dataExporter = DynRenga.DynDocument.DataExporter.DataExporter(renga_project=project)
getExportedObjects3D = DynRenga.DynDocument.DataExporter.GetExportedObjects3D(dataExporter=dataExporter)
