# Dynamo graph test_beams.dyn (Dynamo 2.12.1.8246)

application = DynRenga.DynDocument.Application.Application()
project = DynRenga.DynDocument.Project.Project.Project(renga_application=application)
model = DynRenga.DynDocument.Model.Model(project=project)
objectTypes = DynRenga.DynObjects.General.ObjectTypes()
getObjectsByType = DynRenga.DynObjects.Selection.GetObjectsByType(renga_model=model, object_type=objectTypes.Beam)
modelObject = DynRenga.DynObjects.ModelObject.ModelObject(model_object_com=getObjectsByType)
name = DynRenga.DynObjects.ModelObject.Name(modelObject=modelObject)
beamParams = DynRenga.DynProperties.Parameters.ObjectsParam.BeamParams.BeamParams(ModelObject_Beam=modelObject)
styleId = DynRenga.DynProperties.Parameters.ObjectsParam.BeamParams.StyleId(beamParams=beamParams)
beamStyle = DynRenga.DynProperties.Parameters.ObjectsParam.BeamStyle.BeamStyle(renga_project=project, BeamStyle_id=styleId)
id = DynRenga.DynProperties.Parameters.ObjectsParam.BeamStyle.Id(beamStyle=beamParams)
getObjectsData = DynRenga.DynObjects.ModelObject.GetObjectsData(modelObject=modelObject)
