# Dynamo graph test_routes.dyn (Dynamo 2.12.1.8246)

objectTypes = DynRenga.DynObjects.General.ObjectTypes()

# group: Получение всех трасс
application = DynRenga.DynDocument.Application.Application()
project = DynRenga.DynDocument.Project.Project.Project(renga_application=application)
model = DynRenga.DynDocument.Model.Model(project=project)
getObjectsByType = DynRenga.DynObjects.Selection.GetObjectsByType(renga_model=model, object_type=objectTypes.Route)
routeParams = DynRenga.DynProperties.Parameters.ObjectsParam.RouteParams.RouteParams(ModelObject_Route=getObjectsByType)

# group: Преобразование геометрии трассы в грубую кривую
getContour = DynRenga.DynProperties.Parameters.ObjectsParam.RouteParams.GetContour(routeParams=routeParams)
curve3D = DynRenga.DynGeometry.Curve3D.Curve3D(Curve3D_object=getContour)
code_block = CodeBlock { 10; }
toDynamoPolyCurve = DynRenga.DynGeometry.Curve3D.ToDynamoPolyCurve(curve3D=curve3D, parts_in_meter=code_block)

# group: Стиль системы
systemStyleId = DynRenga.DynProperties.Parameters.ObjectsParam.RouteParams.SystemStyleId(routeParams=routeParams)
systemStyle = DynRenga.DynProperties.Parameters.ObjectsParam.SystemStyle.SystemStyle(renga_project=project, SystemStyle_id=systemStyleId)
designation = DynRenga.DynProperties.Parameters.ObjectsParam.SystemStyle.Designation(systemStyle=systemStyle)
color = DynRenga.DynProperties.Parameters.ObjectsParam.SystemStyle.Color(systemStyle=systemStyle)
getColorDataByRengaColor = DynRenga.Other.RengaSimpleInterfaces.GetColorDataByRengaColor(renga_color_obj=color)

# group: Получение параметров объектов системы
modelObject = DynRenga.DynObjects.ModelObject.ModelObject(model_object_com=getObjectsByType)
getObjectsData = DynRenga.DynObjects.ModelObject.GetObjectsData(modelObject=modelObject)
parameterContainer = DynRenga.DynProperties.Parameters.ParameterContainer.ParameterContainer(ParameterContainer_obj=getObjectsData.Parameters_IParameterContainer)
getParameters = DynRenga.DynProperties.Parameters.ParameterContainer.GetParameters(parameterContainer=parameterContainer)
parameter = DynRenga.DynProperties.Parameters.Parameter.Parameter(Parameter_obj_com=getParameters.Parameters_object)
getValue = DynRenga.DynProperties.Parameters.Parameter.GetValue(parameter=parameter)
definition = DynRenga.DynProperties.Parameters.Parameter.Definition(parameter=parameter)
parameterDefinition = DynRenga.DynProperties.Parameters.ParameterDefinition.ParameterDefinition(ParameterDefinition_obj_com=definition)
name = DynRenga.DynProperties.Parameters.ParameterDefinition.Name(parameterDefinition=parameterDefinition)
getParameterTypeAsString = DynRenga.DynProperties.Parameters.ParameterDefinition.GetParameterTypeAsString(parameterDefinition=parameterDefinition)
