# Dynamo graph test_select_in_model.dyn (Dynamo 2.12.1.8246)

application = DynRenga.DynDocument.Application.Application()
project = DynRenga.DynDocument.Project.Project.Project(renga_application=application)
model = DynRenga.DynDocument.Model.Model(project=project)
objectTypes = DynRenga.DynObjects.General.ObjectTypes()
getObjectsByType = DynRenga.DynObjects.Selection.GetObjectsByType(renga_model=model, object_type=objectTypes.AssemblyInstance)
modelObject = DynRenga.DynObjects.ModelObject.ModelObject(model_object_com=getObjectsByType)
id = DynRenga.DynObjects.ModelObject.Id(modelObject=modelObject)
list_create = List.Create(item0=id)
flatten = List.Flatten(list=list_create)
selectObjectsInModelByIds = DynRenga.DynObjects.Selection.SelectObjectsInModelByIds(renga_application=application, model_objects_ids=flatten)
